# Grasshopper definition Attractor Points.gh (Grasshopper 0.9.76)

number_slider = Slider(15, range=0..100)
point = Point([<point referenced from the Rhino model> x3])
square = Square(Plane=PlaneXY(0, 0, 0), Size=1, ExtentX=number_slider, ExtentY=number_slider)  # -> Cells, Points
closest_point = ClosestPoint(Point=square.Points, Cloud=point)  # -> ClosestPoint, CPIndex, Distance
point_2 = Point(square.Points)
construct_domain = ConstructDomain(DomainStart=Slider(1, range=0..1), DomainEnd=Slider(0.1, range=0..0.1))
bounds = Bounds(Numbers=closest_point.Distance)
polygon = Polygon(Plane=point_2, Radius=Slider(0.47, range=0..1), Segments=Slider(4, range=0..10), FilletRadius=Slider(0.1, range=0..1))  # -> Polygon, Length
remap_numbers = RemapNumbers(Value=closest_point.Distance, Source=bounds, Target=construct_domain)  # -> Mapped, Clipped
scale = Scale(Geometry=polygon.Polygon, Center=square.Points, Factor=remap_numbers.Clipped)  # -> Geometry, Transform
point_3 = Point(<point referenced from the Rhino model>)
closest_point_2 = ClosestPoint(Point=square.Points, Cloud=point_3)  # -> ClosestPoint, CPIndex, Distance
bounds_2 = Bounds(Numbers=closest_point_2.Distance)
construct_domain_2 = ConstructDomain(DomainStart=0, DomainEnd=Slider(45, range=0..100))
remap_numbers_2 = RemapNumbers(Value=closest_point_2.Distance, Source=bounds_2, Target=construct_domain_2)  # -> Mapped, Clipped
radians = Radians(Degrees=remap_numbers_2.Clipped)
rotate = Rotate(Geometry=scale.Geometry, Angle=radians, Plane=square.Points)  # -> Geometry, Transform
curve = Curve(<curve referenced from the Rhino model>)
divide_curve = DivideCurve(Curve=curve, Count=Slider(12, range=0..100), Kinks=False)  # -> Points, Tangents, Parameters
closest_point_3 = ClosestPoint(Point=square.Points, Cloud=divide_curve.Points)  # -> ClosestPoint, CPIndex, Distance
bounds_3 = Bounds(Numbers=closest_point_3.Distance)
construct_domain_3 = ConstructDomain(DomainStart=Slider(0.1, range=0..0.1), DomainEnd=1)
remap_numbers_3 = RemapNumbers(Value=closest_point_3.Distance, Source=bounds_3, Target=construct_domain_3)  # -> Mapped, Clipped
unit_z = UnitZ(Factor=remap_numbers_3.Clipped)
extrude = Extrude(Base=rotate.Geometry, Direction=unit_z)
cap_holes = CapHoles(Brep=extrude)
