# Grasshopper definition Brisolei Facade v2.gh (Grasshopper 1.0.4)

polygon = Polygon(Plane=PlaneXY(0, 0, 0), Radius=Slider(2, range=0..10), Segments=Slider(3, range=0..10), FilletRadius=0)  # -> Polygon, Length
radians = Radians(Degrees=Slider(90, range=0..100))
rotate = Rotate(Geometry=polygon.Polygon, Angle=radians, Plane=PlaneXY(0, 0, 0))  # -> Geometry, Transform
explode = Explode(Curve=rotate.Geometry, Recursive=True)  # -> Segments, Vertices

number_slider = Slider(1, range=0..10)
number_slider_2 = Slider(2, range=0..10)
list_item = ListItem(List=explode.Segments, Index=0, Wrap=True)
list_item_2 = ListItem(List=explode.Segments, Index=number_slider, Wrap=True)
list_item_3 = ListItem(List=explode.Segments, Index=number_slider_2, Wrap=True)

list_item_4 = ListItem(List=explode.Vertices, Index=0, Wrap=True)
list_item_5 = ListItem(List=explode.Vertices, Index=number_slider, Wrap=True)
# Points of Diamond Shape
list_item_6 = ListItem(List=explode.Vertices, Index=number_slider_2, Wrap=True)

mirror_curve = MirrorCurve(Geometry=rotate.Geometry, Curve=list_item_2, Tangent=True)
explode_2 = Explode(Curve=mirror_curve, Recursive=True)  # -> Segments, Vertices

list_item_7 = ListItem(List=explode_2.Vertices, Index=0, Wrap=True)
list_item_8 = ListItem(List=explode_2.Vertices, Index=number_slider, Wrap=True)
list_item_9 = ListItem(List=explode_2.Vertices, Index=number_slider_2, Wrap=True)

panel = Panel("""0
1
2
3""")
weave = Weave(Pattern=panel, Stream0=list_item_5, Stream1=list_item_4, Stream2=list_item_9, Stream3=list_item_7, NullGaps=False)
polyline = PolyLine(Vertices=weave, Closed=Slider(1, range=0..1))
panel_2 = Panel(weave)
area = Area(Geometry=polyline)  # -> Area, Centroid

distance = Distance(PointA=list_item_9, PointB=area.Centroid)
distance_2 = Distance(PointA=area.Centroid, PointB=list_item_7)
distance_3 = Distance(PointA=list_item_4, PointB=list_item_7)

distance_4 = Distance(PointA=list_item_9, PointB=list_item_8)
number_in_x_direction = Slider(15, range=0..100)
series = Series(Start=0, Step=distance_4, Count=number_in_x_direction)
unit_x = UnitX(Factor=series)
move = Move(Geometry=polyline, Motion=unit_x)  # -> Geometry, Transform
unit_x_2 = UnitX(Factor=distance)
number_in_y_direction = Slider(12, range=0..20)
move_2 = Move(Geometry=move.Geometry, Motion=unit_x_2)  # -> Geometry, Transform
unit_y = UnitY(Factor=distance_2)
move_3 = Move(Geometry=move_2.Geometry, Motion=unit_y)  # -> Geometry, Transform
subtraction = Subtraction(A=number_in_x_direction, B=Slider(1, range=0..1))
series_2 = Series(Start=0, Step=distance_3, Count=number_in_y_direction)
panel_3 = Panel(move_3.Geometry)
cull_index = CullIndex(List=move_3.Geometry, Indices=subtraction, Wrap=True)
panel_4 = Panel(cull_index)
unit_y_2 = UnitY(Factor=series_2)
graft_tree = GraftTree(Tree=move.Geometry, IncludeEmptyLists=True, IncludeNullItems=True)
graft_tree_2 = GraftTree(Tree=cull_index, IncludeEmptyLists=True, IncludeNullItems=True)
move_4 = Move(Geometry=[graft_tree_2, graft_tree], Motion=unit_y_2)  # -> Geometry, Transform
offset_curve = OffsetCurve(Curve=move_4.Geometry, Distance=Slider(0.25, range=0..1), Plane=PlaneXY(0, 0, 0), Corners=1)
panel_5 = Panel(move_4.Geometry)
flatten_tree = FlattenTree(Tree=offset_curve, Path="{0}")
panel_6 = Panel(offset_curve)
graft_tree_3 = GraftTree(Tree=move_4.Geometry, IncludeEmptyLists=True, IncludeNullItems=True)
graft_tree_4 = GraftTree(Tree=offset_curve, IncludeEmptyLists=True, IncludeNullItems=True)
partition_list = PartitionList(List=flatten_tree, Size=number_in_y_direction)
panel_7 = Panel(flatten_tree)

boundary_surfaces = BoundarySurfaces(Edges=offset_curve)
thickness_of_bottom_piece = Slider(0.5, range=0..1)
unit_z = UnitZ(Factor=thickness_of_bottom_piece)
extrude = Extrude(Base=boundary_surfaces, Direction=unit_z)  # -> graft(Extrusion)

area_2 = Area(Geometry=move_4.Geometry)  # -> Area, Centroid
circle = Circle(Plane=area_2.Centroid, Radius=Slider(1.112, range=0..10))
# Circle Geometry
addition = Addition(A=thickness_of_bottom_piece, B=Slider(1, range=0..1))
unit_z_2 = UnitZ(Factor=addition)
extrude_2 = Extrude(Base=circle, Direction=unit_z_2)
cap_holes = CapHoles(Brep=extrude_2)  # -> graft(Brep)

region_difference = RegionDifference(CurvesA=graft_tree_3, CurvesB=graft_tree_4)
panel_8 = Panel(partition_list)
boundary_surfaces_2 = BoundarySurfaces(Edges=region_difference)
unit_z_3 = UnitZ(Factor=Slider(2, range=0..10))

solid_difference = SolidDifference(SubtractFrom=extrude, SubtractWith=cap_holes)
# Bake Me!
extrude_3 = Extrude(Base=boundary_surfaces_2, Direction=unit_z_3)
