# Grasshopper definition City View Miami.gh (Grasshopper 1.0.4)

number_slider = Slider(5, range=0..10)
hexagonal = Hexagonal(Plane=PlaneXY(0, 0, 0), Size=1, ExtentX=number_slider, ExtentY=number_slider)  # -> Cells, Points
rotate = Rotate(Geometry=hexagonal.Cells, Angle=1.570796327, Plane=PlaneXY(0, 0, 0))  # -> Geometry, Transform
explode = Explode(Curve=rotate.Geometry, Recursive=True)  # -> Segments, Vertices
list_item = ListItem(List=explode.Vertices, Index=Slider(0, range=0..100), Wrap=True)
list_item_2 = ListItem(List=explode.Vertices, Index=Slider(1, range=0..1), Wrap=True)
list_item_3 = ListItem(List=explode.Vertices, Index=Slider(2, range=0..10), Wrap=True)
list_item_4 = ListItem(List=explode.Vertices, Index=Slider(3, range=0..10), Wrap=True)
list_item_5 = ListItem(List=explode.Vertices, Index=Slider(4, range=0..10), Wrap=True)
list_item_6 = ListItem(List=explode.Vertices, Index=Slider(5, range=0..10), Wrap=True)
number_slider_2 = Slider(2, range=0..10)
list_item_7 = ListItem(List=explode.Segments, Index=Slider(1, range=0..1), Wrap=True)
list_item_8 = ListItem(List=explode.Segments, Index=Slider(4, range=0..10), Wrap=True)
line = Line(StartPoint=list_item, EndPoint=list_item_4)
divide_curve = DivideCurve(Curve=list_item_7, Count=number_slider_2, Kinks=False)  # -> Points, Tangents, Parameters
divide_curve_2 = DivideCurve(Curve=list_item_8, Count=number_slider_2, Kinks=False)  # -> Points, Tangents, Parameters
number_slider_3 = Slider(1, range=0..1)
list_item_9 = ListItem(List=divide_curve.Points, Index=number_slider_3, Wrap=True)
list_item_10 = ListItem(List=divide_curve_2.Points, Index=number_slider_3, Wrap=True)
line_2 = Line(StartPoint=list_item_9, EndPoint=list_item_10)
point = Point(<point referenced from the Rhino model>)
curve_curve = CurveCurve(CurveA=line_2, CurveB=line)  # -> Points, ParamsA, ParamsB
distance = Distance(PointA=flatten(curve_curve.Points), PointB=point)
bounds = Bounds(Numbers=distance)
construct_domain = ConstructDomain(DomainStart=Slider(0.028, range=0..100), DomainEnd=Slider(0.447, range=0..1))
vector_2pt = Vector2Pt(PointA=curve_curve.Points, PointB=list_item_9, Unitize=False)  # -> Vector, Length
panel = Panel(curve_curve.Points)
remap_numbers = RemapNumbers(Value=graft(distance), Source=bounds, Target=construct_domain)  # -> Mapped, Clipped
amplitude = Amplitude(Vector=vector_2pt.Vector, Amplitude=remap_numbers.Mapped)
move = Move(Geometry=curve_curve.Points, Motion=amplitude)  # -> Geometry, Transform
panel_2 = Panel(move.Geometry)
_4point_surface = _4PointSurface(CornerA=move.Geometry, CornerB=list_item, CornerC=list_item_2, CornerD=list_item_9)
_4point_surface_2 = _4PointSurface(CornerA=move.Geometry, CornerB=list_item_4, CornerC=list_item_3, CornerD=list_item_9)
brep_join = BrepJoin(Breps=[_4point_surface, _4point_surface_2])  # -> Breps, Closed
radians = Radians(Degrees=Slider(180, range=0..1000))
rotate_2 = Rotate(Geometry=brep_join.Breps, Angle=radians, Plane=curve_curve.Points)  # -> Geometry, Transform
