# Grasshopper definition Contour Table v2.gh (Grasshopper 1.0.4)

number_slider = Slider(27, range=0..100)
number_slider_2 = Slider(30, range=0..100)
plane_surface = PlaneSurface(Plane=PlaneXY(0, 0, 0), XSize=number_slider, YSize=number_slider)
number_slider_3 = Slider(13, range=0..100)
divide_surface = DivideSurface(Surface=plane_surface, UCount=number_slider_2, VCount=number_slider_2)  # -> flatten(Points), Normals, Parameters
panel = Panel(divide_surface.Points)
explode = Explode(Curve=plane_surface, Recursive=True)  # -> Segments, Vertices
number_slider_4 = Slider(9, range=0..100)
point = Point(divide_surface.Normals)
panel_2 = Panel(explode.Vertices)
area = Area(Geometry=plane_surface)  # -> Area, Centroid
construct_domain = ConstructDomain(DomainStart=number_slider_4, DomainEnd=Slider(0, range=0..100))
list_item = ListItem(List=explode.Vertices, Index=0, Wrap=True)
list_item_2 = ListItem(List=explode.Vertices, Index=Slider(1, range=0..1), Wrap=True)
list_item_3 = ListItem(List=explode.Vertices, Index=Slider(2, range=0..10), Wrap=True)
list_item_4 = ListItem(List=explode.Vertices, Index=Slider(3, range=0..10), Wrap=True)
unit_z = UnitZ(Factor=number_slider_4)
unit_z_2 = UnitZ(Factor=number_slider_4)
unit_z_3 = UnitZ(Factor=number_slider_4)
unit_z_4 = UnitZ(Factor=number_slider_4)
unit_z_5 = UnitZ(Factor=number_slider_4)
move = Move(Geometry=area.Centroid, Motion=unit_z_5)  # -> Geometry, Transform
move_2 = Move(Geometry=list_item, Motion=unit_z)  # -> Geometry, Transform
move_3 = Move(Geometry=list_item_2, Motion=unit_z_2)  # -> Geometry, Transform
move_4 = Move(Geometry=list_item_3, Motion=unit_z_3)  # -> Geometry, Transform
move_5 = Move(Geometry=list_item_4, Motion=unit_z_4)  # -> Geometry, Transform
addition = Addition(A=number_slider_2, B=Slider(1, range=0..1))
merge = Merge(Data1=move_2.Geometry, Data2=move_3.Geometry, Data3=move_4.Geometry, Data4=move_5.Geometry, Data5=move.Geometry)  # -> flatten(Result)
closest_point = ClosestPoint(Point=divide_surface.Points, Cloud=merge)  # -> ClosestPoint, CPIndex, Distance
graph_mapper = GraphMapper(
    closest_point.Distance,
    x0=0,
    x1=15,
    y0=0,
    y1=15,
    container_name="Bezier",
    cpx=[0, 0.07869911194, 0.3972763121, 1],
    cpy=[0, 0.8467495441, 0.9713548422, 1])
bounds = Bounds(Numbers=graph_mapper)
remap_numbers = RemapNumbers(Value=graph_mapper, Source=bounds, Target=construct_domain)  # -> Mapped, Clipped
amplitude = Amplitude(Vector=point, Amplitude=remap_numbers.Mapped)
panel_3 = Panel(remap_numbers.Mapped)
move_6 = Move(Geometry=divide_surface.Points, Motion=amplitude)  # -> Geometry, Transform
number_slider_5 = Slider(1, range=0..1)
_4point_surface = _4PointSurface(CornerA=move_2.Geometry, CornerB=move_3.Geometry, CornerC=move_4.Geometry, CornerD=move_5.Geometry)
panel_4 = Panel(merge)
surface_from_points = SurfaceFromPoints(Points=move_6.Geometry, UCount=addition, Interpolate=False)
unit_z_6 = UnitZ(Factor=number_slider_5)
unit_z_7 = UnitZ(Factor=number_slider_5)
extrude = Extrude(Base=surface_from_points, Direction=unit_z_6)
number_slider_6 = Slider(0.5, range=0..1)
unit_x = UnitX(Factor=1)
move_7 = Move(Geometry=_4point_surface, Motion=unit_z_7)  # -> Geometry, Transform
contour = Contour(Shape=extrude, Point=Point(0, 0, 0), Direction=unit_x, Distance=number_slider_6)
panel_5 = Panel(move_7.Geometry)
unit_z_8 = UnitZ(Factor=Slider(0.5, range=0..1))
extrude_2 = Extrude(Base=move_7.Geometry, Direction=unit_z_8)
fillet = Fillet(Curve=contour, Radius=Slider(0.45, range=0..1))
subtraction = Subtraction(A=number_slider_6, B=Slider(0.187, range=0..1))
boundary_surfaces = BoundarySurfaces(Edges=fillet)
unit_x_2 = UnitX(Factor=subtraction)
extrude_3 = Extrude(Base=boundary_surfaces, Direction=unit_x_2)
