# Grasshopper definition Creating Spline on Surface.gh (Grasshopper 1.0.5)

surface = Surface(<surface referenced from the Rhino model>)
curve = Curve(<curve referenced from the Rhino model>)
curve_2 = Curve(<curve referenced from the Rhino model>)
number_slider = Slider(19, range=0..100)
deconstruct_brep = DeconstructBrep(Brep=surface)  # -> Faces, Edges, Vertices
loft = Loft(
    Curves=[curve, curve_2],
    Options={Adjust=False, Closed=False, LoftEnds=0, LoftSimp=0, LoftType=0, Rebuild=10, Refit=0.01})
list_item = ListItem(List=deconstruct_brep.Edges, Index=0, Wrap=True)  # -> Item, Item1, Item2, Item3
divide_surface = DivideSurface(Surface=loft, UCount=number_slider, VCount=number_slider)  # -> Points, Normals, Parameters
number_slider_2 = Slider(59, range=0..100)
curve_3 = Curve(list_item.Item1)
curve_4 = Curve(list_item.Item3)
panel = Panel(divide_surface.Points)
flip_matrix = FlipMatrix(Data=divide_surface.Points)
divide_curve = DivideCurve(Curve=curve_3, Count=number_slider_2, Kinks=False)  # -> Points, Tangents, Parameters
divide_curve_2 = DivideCurve(Curve=curve_4, Count=number_slider_2, Kinks=False)  # -> Points, Tangents, Parameters
interpolate = Interpolate(Vertices=divide_surface.Points, Degree=3, Periodic=False, KnotStyle=1)  # -> Curve, Length, Domain
interpolate_2 = Interpolate(Vertices=flip_matrix, Degree=3, Periodic=False, KnotStyle=1)  # -> Curve, Length, Domain
reverse_list = ReverseList(List=divide_curve.Points)
number_slider_3 = Slider(2, range=0..10)
length = Length(Curve=interpolate_2.Curve)
line = Line(StartPoint=reverse_list, EndPoint=divide_curve_2.Points)
length_2 = Length(Curve=interpolate.Curve)
division = Division(A=length, B=number_slider_3)
number_slider_4 = Slider(0.08, range=0..1)
panel_2 = Panel(interpolate.Curve)
evaluate_curve = EvaluateCurve(Curve=line, Parameter=Slider(0.5, range=0..1))  # -> Point, Tangent, Angle
division_2 = Division(A=length_2, B=number_slider_3)
evaluate_curve_2 = EvaluateCurve(Curve=interpolate_2.Curve, Parameter=division)  # -> Point, Tangent, Angle
unit_x = UnitX(Factor=number_slider_4)
unit_x_2 = UnitX(Factor=number_slider_4)
interpolate_3 = Interpolate(Vertices=evaluate_curve.Point, Degree=3, Periodic=False, KnotStyle=1)  # -> Curve, Length, Domain
evaluate_curve_3 = EvaluateCurve(Curve=interpolate.Curve, Parameter=division_2)  # -> Point, Tangent, Angle
interpolate_4 = Interpolate(Vertices=flatten(evaluate_curve_2.Point), Degree=3, Periodic=False, KnotStyle=1)  # -> Curve, Length, Domain
negative = Negative(Value=unit_x_2)
panel_3 = Panel(evaluate_curve_3.Point)
extrude = Extrude(Base=interpolate_3.Curve, Direction=unit_x)
extrude_2 = Extrude(Base=interpolate_3.Curve, Direction=negative)
interpolate_5 = Interpolate(Vertices=flatten(evaluate_curve_3.Point), Degree=3, Periodic=False, KnotStyle=1)  # -> Curve, Length, Domain
surface_split = SurfaceSplit(Surface=extrude_2, Curves=line)
panel_4 = Panel(extrude)
list_item_2 = ListItem(List=surface_split, Index=0, Wrap=True)
panel_5 = Panel(surface_split)
brep_join = BrepJoin(Breps=[extrude_2, extrude])  # -> Breps, Closed
surface_split_2 = SurfaceSplit(Surface=extrude, Curves=line)
panel_6 = Panel("""1
1
1
0""")
surface_2 = Surface(list_item_2)
panel_7 = Panel("""0
1""")
list_item_3 = ListItem(List=surface_split_2, Index=Slider(0, range=0..100), Wrap=True)
cull_pattern = CullPattern(List=surface_split, CullPattern=panel_6)
panel_8 = Panel(surface_split_2)
cull_pattern_2 = CullPattern(List=surface_split_2, CullPattern=panel_7)
surface_3 = Surface(list_item_3)
cull_nth = CullNth(List=surface_split, CullFrequency=Slider(2, range=0..10))
merge = Merge(Data1=surface_3, Data2=cull_pattern_2)
brep_join_2 = BrepJoin(Breps=[cull_nth, merge])  # -> Breps, Closed
