# Grasshopper definition Stone Curve Facade.gh (Grasshopper 1.0.7)

number_slider = Slider(10, range=0..10)
number_slider_2 = Slider(3, range=0..50)
number_slider_3 = Slider(100, range=0..100)
number_slider_4 = Slider(12, range=0..100)
number_slider_5 = Slider(90, range=0..100)
subtraction = Subtraction(A=number_slider_3, B="1")
range = Range(Domain=Domain(0, 1), Steps=subtraction)
series = Series(Start=0, Step=number_slider_2, Count=number_slider_3)
negative = Negative(Value=Slider(4.33, range=0..10))
division = Division(A=number_slider_5, B="2")
graph_mapper = GraphMapper(range, x0=0, x1=1, y0=0, y1=1, container_name="Sine", Equation_px=[0, 0.1110313535], Equation_py=[0, 0.9933360815])
graph_mapper_2 = GraphMapper(range, x0=0, x1=1, y0=0, y1=1, container_name="Sine", Equation_px=[0, 0.06097452343], Equation_py=[1, 0])
construct_point = ConstructPoint(XCoordinate=series, YCoordinate=0, ZCoordinate=0)
graph_mapper_3 = GraphMapper(range, x0=0, x1=1, y0=0, y1=1, container_name="Sine", Equation_px=[0, 0.1112392247], Equation_py=[1, 0])
construct_point_2 = ConstructPoint(XCoordinate=series, YCoordinate=0, ZCoordinate=number_slider_5)
multiplication = Multiplication(A=graph_mapper, B=number_slider)
construct_point_3 = ConstructPoint(XCoordinate=series, YCoordinate=0, ZCoordinate=Slider(26, range=0..100))
multiplication_2 = Multiplication(A=graph_mapper_3, B=number_slider)
multiplication_3 = Multiplication(A=graph_mapper_2, B=negative)
unit_y = UnitY(Factor=multiplication)
unit_y_2 = UnitY(Factor=multiplication_3)
unit_y_3 = UnitY(Factor=multiplication_2)
move = Move(Geometry=construct_point_2, Motion=unit_y)  # -> Geometry, Transform
move_2 = Move(Geometry=construct_point_3, Motion=unit_y_2)  # -> Geometry, Transform
move_3 = Move(Geometry=construct_point, Motion=unit_y_3)  # -> Geometry, Transform
interpolate = Interpolate(Vertices=move_3.Geometry, Degree=3, Periodic=False, KnotStyle=1)  # -> Curve, Length, Domain
merge = Merge(Data1=graft(move.Geometry), Data2=graft(move_2.Geometry), Data3=graft(move_3.Geometry))
interpolate_2 = Interpolate(Vertices=merge, Degree=3, Periodic=False, KnotStyle=1)  # -> flatten(Curve), Length, Domain
number_slider_6 = Slider(10, range=0..10)
division_2 = Division(A=number_slider_2, B="2")
number_slider_7 = Slider(1.81, range=0..10)
panel = Panel(merge)
extend_curve = ExtendCurve(Curve=interpolate_2.Curve, Type=2, Start=number_slider_6, End=number_slider_6)
flip_curve = FlipCurve(Curve=extend_curve)  # -> Curve, Flag
negative_2 = Negative(Value=number_slider_7)
negative_3 = Negative(Value=division_2)
perp_frame = PerpFrame(Curve=reparameterize(flip_curve.Curve), Parameter="0")
construct_domain = ConstructDomain(DomainStart=negative_3, DomainEnd=division_2)
construct_domain_2 = ConstructDomain(DomainStart=negative_2, DomainEnd=number_slider_7)
rectangle = Rectangle(Plane=perp_frame, XSize=construct_domain_2, YSize=construct_domain, Radius=0)  # -> Rectangle, Length
sweep1 = Sweep1(Rail=graft(flip_curve.Curve), Sections=graft(rectangle.Rectangle), Miter=1)
cap_holes = CapHoles(Brep=sweep1)
custom_preview = CustomPreview(
    Geometry=cap_holes,
    Material={diffuse=RGB(128, 128, 128), emission=RGB(192, 192, 192), shine=0.5, specular=RGB(211, 211, 211), transparency=0})
