# Grasshopper definition Diamond Tower Jeddeh.gh (Grasshopper 1.0.4)
# plug-ins: LunchBox

number_slider = Slider(12, range=0..100)
number_slider_2 = Slider(236, range=0..1000)
number_slider_3 = Slider(44, range=0..100)
addition = Addition(A=number_slider, B=Slider(15, range=0..100))
addition_2 = Addition(A=number_slider, B=Slider(5, range=0..10))
addition_3 = Addition(A=number_slider, B=Slider(10, range=0..100))
cylinder = Cylinder(Base=PlaneXY(0, 0, 0), Radius=number_slider, Length=number_slider_2)
circle = Circle(Plane=PlaneXY(0, 0, 0), Radius=addition)
circle_2 = Circle(Plane=PlaneXY(0, 0, 0), Radius=addition_2)
division = Division(A=number_slider_2, B=number_slider_3)
addition_4 = Addition(A=number_slider_3, B=Slider(1, range=0..1))
cap_holes = CapHoles(Brep=cylinder)
unit_z = UnitZ(Factor=Slider(24, range=0..100))
series = Series(Start=0, Step=division, Count=addition_4)
polygon = Polygon(Plane=PlaneXY(0, 0, 0), Radius=addition_3, Segments=Slider(4, range=0..10), FilletRadius=0)  # -> Polygon, Length
number_slider_4 = Slider(37, range=0..100)
move = Move(Geometry=circle_2, Motion=unit_z)  # -> Geometry, Transform
unit_z_2 = UnitZ(Factor=series)
construct_domain = ConstructDomain(DomainStart=Slider(0, range=0..100), DomainEnd=Slider(231, range=0..360))
move_2 = Move(Geometry=polygon.Polygon, Motion=unit_z_2)  # -> Geometry, Transform
loft = Loft(
    Curves=[circle, move.Geometry],
    Options={Adjust=False, Closed=False, LoftEnds=0, LoftSimp=0, LoftType=0, Rebuild=10, Refit=0.01})
quad_panels = QuadPanels(Surface=cylinder, UDivisions=number_slider_4, VDivisions=number_slider_4)
range = Range(Domain=construct_domain, Steps=number_slider_3)
brep_join = BrepJoin(Breps=quad_panels)  # -> Breps, Closed
unit_z_3 = UnitZ(Factor=range)
cap_holes_2 = CapHoles(Brep=loft)
cap_holes_3 = CapHoles(Brep=brep_join.Breps)
radians = Radians(Degrees=unit_z_3)
rotate = Rotate(Geometry=move_2.Geometry, Angle=radians, Plane=PlaneXY(0, 0, 0))  # -> Geometry, Transform
explode = Explode(Curve=rotate.Geometry, Recursive=True)  # -> Segments, Vertices
panel = Panel(explode.Vertices)
list_item = ListItem(List=explode.Vertices, Index=Slider(0, range=0..100), Wrap=True)
list_item_2 = ListItem(List=explode.Vertices, Index=Slider(1, range=0..1), Wrap=True)
list_item_3 = ListItem(List=explode.Vertices, Index=Slider(2, range=0..10), Wrap=True)
list_item_4 = ListItem(List=explode.Vertices, Index=Slider(3, range=0..10), Wrap=True)
panel_2 = Panel(list_item)

number_slider_5 = Slider(3, range=0..100)
number_slider_6 = Slider(6, range=0..10)
negative = Negative(Value=number_slider_5)
negative_2 = Negative(Value=number_slider_6)
construct_domain_2 = ConstructDomain(DomainStart=negative_2, DomainEnd=number_slider_6)
construct_domain_3 = ConstructDomain(DomainStart=negative, DomainEnd=number_slider_5)

flatten_tree = FlattenTree(Tree=list_item, Path="{0}")
flatten_tree_2 = FlattenTree(Tree=list_item_2, Path="{0}")
flatten_tree_3 = FlattenTree(Tree=list_item_3, Path="{0}")
flatten_tree_4 = FlattenTree(Tree=list_item_4, Path="{0}")
interpolate = Interpolate(Vertices=flatten_tree, Degree=3, Periodic=False, KnotStyle=1)  # -> Curve, Length, Domain
interpolate_2 = Interpolate(Vertices=flatten_tree_2, Degree=3, Periodic=False, KnotStyle=1)  # -> Curve, Length, Domain
interpolate_3 = Interpolate(Vertices=flatten_tree_3, Degree=3, Periodic=False, KnotStyle=1)  # -> Curve, Length, Domain
interpolate_4 = Interpolate(Vertices=flatten_tree_4, Degree=3, Periodic=False, KnotStyle=1)  # -> Curve, Length, Domain
perp_frames = PerpFrames(Curve=interpolate.Curve, Count=10, Align=True)  # -> Frames, Parameters
perp_frames_2 = PerpFrames(Curve=interpolate_2.Curve, Count=10, Align=True)  # -> Frames, Parameters
perp_frames_3 = PerpFrames(Curve=interpolate_3.Curve, Count=10, Align=True)  # -> Frames, Parameters
perp_frames_4 = PerpFrames(Curve=interpolate_4.Curve, Count=10, Align=True)  # -> Frames, Parameters
rectangle = Rectangle(Plane=perp_frames_3.Frames, XSize=construct_domain_3, YSize=construct_domain_2, Radius=0)  # -> Rectangle, Length
rectangle_2 = Rectangle(Plane=perp_frames.Frames, XSize=construct_domain_2, YSize=construct_domain_3, Radius=0)  # -> Rectangle, Length
rectangle_3 = Rectangle(Plane=perp_frames_2.Frames, XSize=construct_domain_3, YSize=construct_domain_2, Radius=0)  # -> Rectangle, Length
rectangle_4 = Rectangle(Plane=perp_frames_4.Frames, XSize=construct_domain_3, YSize=construct_domain_2, Radius=0)  # -> Rectangle, Length
sweep1 = Sweep1(Rail=interpolate.Curve, Sections=rectangle_2.Rectangle, Miter=1)
sweep1_2 = Sweep1(Rail=interpolate_2.Curve, Sections=rectangle_3.Rectangle, Miter=1)
sweep1_3 = Sweep1(Rail=interpolate_3.Curve, Sections=rectangle.Rectangle, Miter=1)
sweep1_4 = Sweep1(Rail=interpolate_4.Curve, Sections=rectangle_4.Rectangle, Miter=1)
cap_holes_4 = CapHoles(Brep=[sweep1, sweep1_2, sweep1_3, sweep1_4])
