# Grasshopper definition Expo 2015 Milano.gh (Grasshopper 1.0.5)

plane_surface = PlaneSurface(Plane=PlaneXY(0, 0, 0), XSize=Domain(-10, 10), YSize=Domain(-10, 10))
populate_2d = Populate2D(Region=plane_surface, Count=Slider(5, range=0..10), Seed=1)
circle = Circle(Plane=populate_2d, Radius=1)
construct_domain = ConstructDomain(DomainStart=Slider(1, range=0..1), DomainEnd=Slider(2, range=0..10))
area = Area(Geometry=circle)  # -> Area, Centroid
panel = Panel(area.Centroid)
list_length = ListLength(List=circle)
graft_tree = GraftTree(Tree=circle, IncludeEmptyLists=True, IncludeNullItems=True)
random = Random(Range=construct_domain, Number=list_length, Seed=2)
number_slider = Slider(11, range=0..100)
panel_2 = Panel(graft_tree)
series = Series(Start=0, Step=random, Count=number_slider)
subtraction = Subtraction(A=number_slider, B=Slider(1, range=0..1))
unit_z = UnitZ(Factor=series)
move = Move(Geometry=graft_tree, Motion=unit_z)  # -> Geometry, Transform
number_slider_2 = Slider(6, range=0..10)
construct_domain_2 = ConstructDomain(DomainStart=Slider(1.239, range=0..2), DomainEnd=Slider(5, range=0..10))
split_list = SplitList(List=move.Geometry, Index=number_slider_2)  # -> ListA, ListB
subtraction_2 = Subtraction(A=number_slider, B=number_slider_2)
area_2 = Area(Geometry=split_list.ListB)  # -> Area, Centroid
subtraction_3 = Subtraction(A=subtraction_2, B=Slider(1, range=0..1))
panel_3 = Panel(move.Geometry)
range = Range(Domain=construct_domain_2, Steps=subtraction_3)
geometry = Geometry(split_list.ListA)
panel_4 = Panel(split_list.ListB)
scale = Scale(Geometry=split_list.ListB, Center=area_2.Centroid, Factor=range)  # -> Geometry, Transform
panel_5 = Panel(area_2.Centroid)
number_slider_3 = Slider(18, range=0..100)
loft = Loft(
    Curves=[geometry, scale.Geometry],
    Options={Adjust=False, Closed=False, LoftEnds=0, LoftSimp=0, LoftType=0, Rebuild=10, Refit=0.01})
divide_surface = DivideSurface(Surface=loft, UCount=number_slider_3, VCount=number_slider_3)  # -> Points, Normals, Parameters
panel_6 = Panel(divide_surface.Points)
flatten_tree = FlattenTree(Tree=divide_surface.Points, Path="{0}")
addition = Addition(A=number_slider_3, B=Slider(1, range=0..1))
panel_7 = Panel(flatten_tree)
partition_list = PartitionList(List=flatten_tree, Size=addition)
panel_8 = Panel(partition_list)
flip_matrix = FlipMatrix(Data=partition_list)
panel_9 = Panel(flip_matrix)
partition_list_2 = PartitionList(List=flip_matrix, Size=addition)
interpolate = Interpolate(Vertices=partition_list_2, Degree=3, Periodic=False, KnotStyle=1)  # -> Curve, Length, Domain
panel_10 = Panel(partition_list_2)
division = Division(A=Slider(0.5, range=0..12), B=Slider(12, range=0..100))
pipe = Pipe(Curve=[geometry, scale.Geometry], Radius=division, Caps=0)
area_3 = Area(Geometry=loft)  # -> Area, flatten(Centroid)
pipe_2 = Pipe(Curve=interpolate.Curve, Radius=division, Caps=0)
panel_11 = Panel(interpolate.Curve)
partition_list_3 = PartitionList(List=flatten(pipe_2), Size=addition)
list_item = ListItem(List=area_3.Centroid, Index=0, Wrap=True)
list_item_2 = ListItem(List=area_3.Centroid, Index=Slider(1, range=0..1), Wrap=True)
list_item_3 = ListItem(List=area_3.Centroid, Index=Slider(2, range=0..10), Wrap=True)
list_item_4 = ListItem(List=area_3.Centroid, Index=Slider(3, range=0..10), Wrap=True)
list_item_5 = ListItem(List=area_3.Centroid, Index=Slider(4, range=0..10), Wrap=True)
list_item_6 = ListItem(List=partition_list_3, Index=0, Wrap=True)
flatten_tree_2 = FlattenTree(Tree=list_item_6, Path="{0}")
merge = Merge(Data1=list_item, Data2=list_item_5, Data3=list_item_4, Data4=list_item_3, Data5=list_item_2)
point = Point(area.Centroid)
panel_12 = Panel(partition_list_3)
panel_13 = Panel(merge)
panel_14 = Panel(list_item_6)
panel_15 = Panel(point)
polar_array = PolarArray(Geometry=flatten_tree_2, Plane=merge, Count=Slider(47, range=0..100), Angle=6.283185307)  # -> Geometry, Transform
cap_holes = CapHoles(Brep=polar_array.Geometry)
