# Grasshopper definition Flatten, Graft, Simplify, Reverse List.gh (Grasshopper 1.0.5)

series = Series(Start=0, Step=1, Count=Slider(29, range=0..100))
construct_point = ConstructPoint(XCoordinate=0, YCoordinate=0, ZCoordinate=0)
unit_x = UnitX(Factor=series)
move = Move(Geometry=construct_point, Motion=unit_x)  # -> Geometry, Transform
series_2 = Series(Start=0, Step=1, Count=10)
unit_y = UnitY(Factor=series_2)
reverse_list = ReverseList(List=move.Geometry)
panel = Panel(move.Geometry)
flatten_tree = FlattenTree(Path="{0}")
panel_2 = Panel(reverse_list)
reverse_list_2 = ReverseList()
graft_tree = GraftTree(Tree=panel, IncludeEmptyLists=True, IncludeNullItems=True)
move_2 = Move(Geometry=graft(move.Geometry), Motion=unit_y)  # -> Geometry, Transform
panel_3 = Panel(graft_tree)
graft_tree_2 = GraftTree(IncludeEmptyLists=True, IncludeNullItems=True)
simplify_tree = SimplifyTree(Tree=panel_3, Front=False)
panel_4 = Panel(simplify_tree)
simplify_tree_2 = SimplifyTree(Front=False)
