# Grasshopper definition Gerhard Mayar Woodwork v2.gh (Grasshopper 0.9.76)

number_slider = Slider(80, range=0..100)
division = Division(A=number_slider, B=Slider(2, range=0..10))
closest_point = ClosestPoint()  # -> ClosestPoint, CPIndex, Distance
square = Square(Plane=PlaneXY(0, 0, 0), Size=1, ExtentX=number_slider, ExtentY=division)  # -> Cells, Points
panel = Panel(square.Points)
point = Point(square.Points)
flatten_tree = FlattenTree(Tree=square.Points, Path="{0}")
point_2 = Point(<point referenced from the Rhino model>)
distance = Distance(PointA=flatten_tree, PointB=point_2)
graph_mapper = GraphMapper(distance, x0=0, x1=15, y0=0, y1=15, container_name="Gaussian", factor=0.2, mean=0.5, sdev=0.4025392532)
negative = Negative(Value=Slider(7, range=0..10))
bounds = Bounds(Numbers=graph_mapper)
construct_domain = ConstructDomain(DomainStart=Slider(0, range=0..100), DomainEnd=negative)
remap_numbers = RemapNumbers(Value=graph_mapper, Source=bounds, Target=construct_domain)  # -> Mapped, Clipped
unit_z = UnitZ(Factor=remap_numbers.Clipped)
move = Move(Geometry=flatten_tree, Motion=unit_z)  # -> Geometry, Transform
point_3 = Point(<point referenced from the Rhino model>)
distance_2 = Distance(PointA=flatten_tree, PointB=point_3)
graph_mapper_2 = GraphMapper(distance_2, x0=0, x1=25, y0=0, y1=25, container_name="Gaussian", factor=0.2060869932, mean=0, sdev=0.5)
bounds_2 = Bounds(Numbers=graph_mapper_2)
construct_domain_2 = ConstructDomain(DomainStart=Slider(0, range=0..100), DomainEnd=Slider(3, range=0..10))
remap_numbers_2 = RemapNumbers(Value=graph_mapper_2, Source=bounds_2, Target=construct_domain_2)  # -> Mapped, Clipped
unit_z_2 = UnitZ(Factor=remap_numbers_2.Clipped)
move_2 = Move(Geometry=move.Geometry, Motion=unit_z_2)  # -> Geometry, Transform
point_4 = Point(<point referenced from the Rhino model>)
distance_3 = Distance(PointA=flatten_tree, PointB=point_4)
graph_mapper_3 = GraphMapper(
    distance_3,
    x0=0,
    x1=10,
    y0=0,
    y1=10,
    container_name="Gaussian",
    factor=0.2060869932,
    mean=0.4666659534,
    sdev=0.197099328)
bounds_3 = Bounds(Numbers=graph_mapper_3)
construct_domain_3 = ConstructDomain(DomainStart=Slider(0, range=0..100), DomainEnd=Slider(6, range=0..10))
remap_numbers_3 = RemapNumbers(Value=graph_mapper_3, Source=bounds_3, Target=construct_domain_3)  # -> Mapped, Clipped
unit_z_3 = UnitZ(Factor=remap_numbers_3.Clipped)
move_3 = Move(Geometry=move_2.Geometry, Motion=unit_z_3)  # -> Geometry, Transform
point_5 = Point(<point referenced from the Rhino model>)
distance_4 = Distance(PointA=flatten_tree, PointB=point_5)
graph_mapper_4 = GraphMapper(distance_4, x0=0, x1=10, y0=0, y1=40, container_name="Gaussian", factor=0.2060869932, mean=1, sdev=0.5286918133)
bounds_4 = Bounds(Numbers=graph_mapper_4)
construct_domain_4 = ConstructDomain(DomainStart=Slider(0, range=0..100), DomainEnd=Slider(4.928, range=0..10))
remap_numbers_4 = RemapNumbers(Value=graph_mapper_4, Source=bounds_4, Target=construct_domain_4)  # -> Mapped, Clipped
unit_z_4 = UnitZ(Factor=remap_numbers_4.Clipped)
move_4 = Move(Geometry=move_3.Geometry, Motion=unit_z_4)  # -> Geometry, Transform
panel_2 = Panel("""1
0""")
cull_pattern = CullPattern(List=move_4.Geometry, CullPattern=panel_2)
unit_z_5 = UnitZ(Factor=Slider(10, range=0..10))
move_5 = Move(Geometry=cull_pattern, Motion=unit_z_5)  # -> Geometry, Transform
circle = Circle(Plane=cull_pattern, Radius=Slider(0.707, range=0..1))
line = Line(StartPoint=cull_pattern, EndPoint=move_5.Geometry)
extrude_along = ExtrudeAlong(BaseWhatYouAreTryingToExtrude=circle, CurveRailingOfHowYouExtrude=line)
cap_holes = CapHoles(Brep=extrude_along)
