# Grasshopper definition How to use Dispatch [3 Different Listing Methods].gh (Grasshopper 1.0.7)
# plug-ins: Pufferfish

hexagonal = Hexagonal(Plane=PlaneXY(0, 0, 0), Size=1, ExtentX=5, ExtentY=5)  # -> Cells, Points
explode = Explode(Curve=hexagonal.Cells, Recursive=True)  # -> Segments, Vertices
area = Area(Geometry=hexagonal.Cells)  # -> Area, graft(Centroid)
evaluate_curve = EvaluateCurve(Curve=reparameterize(explode.Segments), Parameter="0.5")  # -> Point, Tangent, Angle
evaluate_curve_2 = EvaluateCurve(Curve=reparameterize(explode.Segments), Parameter="0.5")  # -> Point, Tangent, Angle

panel = Panel("""1
0""")
curve_middle_point = CurveMiddlePoint(Curve=explode.Segments, EvaluationType=False)  # -> Middle, Tangent, Parameter, Length
dispatch = Dispatch(List=curve_middle_point.Middle, DispatchPattern=panel)  # -> ListA, ListB
line = Line(StartPoint=dispatch.ListA, EndPoint=area.Centroid)
line_2 = Line(StartPoint=dispatch.ListB, EndPoint=area.Centroid)
panel_2 = Panel(dispatch.ListB)
panel_3 = Panel(dispatch.ListA)

list_item = ListItem(List=evaluate_curve.Point, Index=0, Wrap=True)  # -> Item, Item1, Item2, Item3, Item4, Item5
line_3 = Line(StartPoint=list_item.Item5, EndPoint=area.Centroid)
line_4 = Line(StartPoint=list_item.Item, EndPoint=area.Centroid)
line_5 = Line(StartPoint=list_item.Item1, EndPoint=area.Centroid)
line_6 = Line(StartPoint=list_item.Item2, EndPoint=area.Centroid)
line_7 = Line(StartPoint=list_item.Item3, EndPoint=area.Centroid)
line_8 = Line(StartPoint=list_item.Item4, EndPoint=area.Centroid)
merge = Merge(Data1=line_4, Data2=line_6, Data3=line_8)
merge_2 = Merge(Data1=line_5, Data2=line_7, Data3=line_3)

panel_4 = Panel("""1
0""")
cull_pattern = CullPattern(List=evaluate_curve.Point, CullPattern=reverse(panel_4))
cull_pattern_2 = CullPattern(List=evaluate_curve.Point, CullPattern=panel_4)
panel_5 = Panel(cull_pattern_2)
line_9 = Line(StartPoint=area.Centroid, EndPoint=cull_pattern)
line_10 = Line(StartPoint=area.Centroid, EndPoint=cull_pattern_2)
