# Grasshopper definition Facade Study Lesson 2.0.gh (Grasshopper 1.0.4)

number_slider = Slider(5, range=0..10)
hexagonal = Hexagonal(Plane=PlaneXY(0, 0, 0), Size=1, ExtentX=number_slider, ExtentY=number_slider)  # -> Cells, graft(Points)
point = Point(hexagonal.Points)
explode = Explode(Curve=hexagonal.Cells, Recursive=True)  # -> Segments, Vertices
number_slider_2 = Slider(1, range=0..1)
number_slider_3 = Slider(0, range=0..100)
panel = Panel(explode.Vertices)
cull_index = CullIndex(List=explode.Vertices, Indices=Slider(6, range=0..10), Wrap=True)
addition = Addition(A=number_slider_3, B=number_slider_2)
addition_2 = Addition(A=addition, B=number_slider_2)
addition_3 = Addition(A=addition_2, B=number_slider_2)
addition_4 = Addition(A=addition_3, B=number_slider_2)
addition_5 = Addition(A=addition_4, B=number_slider_2)
panel_2 = Panel(cull_index)
list_item = ListItem(List=cull_index, Index=number_slider_3, Wrap=True)
list_item_2 = ListItem(List=cull_index, Index=addition, Wrap=True)
list_item_3 = ListItem(List=cull_index, Index=addition_2, Wrap=True)
list_item_4 = ListItem(List=cull_index, Index=addition_3, Wrap=True)
list_item_5 = ListItem(List=cull_index, Index=addition_4, Wrap=True)
list_item_6 = ListItem(List=cull_index, Index=addition_5, Wrap=True)
panel_3 = Panel(hexagonal.Points)
panel_4 = Panel(list_item)
line = Line(StartPoint=list_item, EndPoint=hexagonal.Points)
line_2 = Line(StartPoint=hexagonal.Points, EndPoint=list_item_2)
list_item_7 = ListItem(List=explode.Segments, Index=0, Wrap=True)
number_slider_4 = Slider(2, range=0..10)
number_slider_5 = Slider(1, range=0..1)
divide_curve = DivideCurve(Curve=line, Count=number_slider_4, Kinks=False)  # -> Points, Tangents, Parameters
divide_curve_2 = DivideCurve(Curve=line_2, Count=number_slider_4, Kinks=False)  # -> Points, Tangents, Parameters
divide_curve_3 = DivideCurve(Curve=list_item_7, Count=number_slider_4, Kinks=False)  # -> Points, Tangents, Parameters
panel_5 = Panel(divide_curve_2.Points)
panel_6 = Panel(divide_curve.Points)
list_item_8 = ListItem(List=divide_curve.Points, Index=number_slider_5, Wrap=True)
list_item_9 = ListItem(List=divide_curve_2.Points, Index=number_slider_5, Wrap=True)
list_item_10 = ListItem(List=divide_curve_3.Points, Index=number_slider_5, Wrap=True)
line_3 = Line(StartPoint=list_item_10, EndPoint=hexagonal.Points)
line_4 = Line(StartPoint=list_item_8, EndPoint=list_item_2)
line_5 = Line(StartPoint=list_item_9, EndPoint=list_item)
curve_curve = CurveCurve(CurveA=line_3, CurveB=line_4)  # -> Points, ParamsA, ParamsB
line_6 = Line(StartPoint=curve_curve.Points, EndPoint=list_item_10)
divide_curve_4 = DivideCurve(Curve=line_6, Count=Slider(2, range=0..10), Kinks=False)  # -> Points, Tangents, Parameters
list_item_11 = ListItem(List=divide_curve_4.Points, Index=Slider(1, range=0..1), Wrap=True)
point_2 = Point(<point referenced from the Rhino model>)
distance = Distance(PointA=flatten(curve_curve.Points), PointB=point_2)
negative = Negative(Value=Slider(0.0625, range=0..0.1))
negative_2 = Negative(Value=Slider(0.283, range=0..1))
panel_7 = Panel(distance)
bounds = Bounds(Numbers=distance)
construct_domain = ConstructDomain(DomainStart=negative, DomainEnd=negative_2)
vector_2pt = Vector2Pt(PointA=list_item_10, PointB=curve_curve.Points, Unitize=False)  # -> Vector, Length
remap_numbers = RemapNumbers(Value=distance, Source=bounds, Target=construct_domain)  # -> Mapped, Clipped
panel_8 = Panel(vector_2pt.Vector)
amplitude = Amplitude(Vector=flatten(vector_2pt.Vector), Amplitude=remap_numbers.Mapped)
move = Move(Geometry=flatten(curve_curve.Points), Motion=amplitude)  # -> Geometry, Transform
panel_9 = Panel(remap_numbers.Mapped)
panel_10 = Panel(curve_curve.Points)
panel_11 = Panel(amplitude)
_4point_surface = _4PointSurface(CornerA=graft(move.Geometry), CornerB=list_item_2, CornerC=curve_curve.Points)
_4point_surface_2 = _4PointSurface(CornerA=graft(move.Geometry), CornerB=list_item, CornerC=curve_curve.Points)
panel_12 = Panel(move.Geometry)
graft_tree = GraftTree(Tree=move.Geometry, IncludeEmptyLists=True, IncludeNullItems=True)
panel_13 = Panel(graft_tree)
brep_join = BrepJoin(Breps=[_4point_surface_2, _4point_surface])  # -> Breps, Closed
polar_array = PolarArray(Geometry=brep_join.Breps, Plane=curve_curve.Points, Count=Slider(3, range=0..10), Angle=6.283185307)  # -> Geometry, Transform
brep_join_2 = BrepJoin(Breps=polar_array.Geometry)  # -> Breps, Closed
polar_array_2 = PolarArray(Geometry=brep_join_2.Breps, Plane=hexagonal.Points, Count=Slider(6, range=0..10), Angle=6.283185307)  # -> Geometry, Transform
