# Grasshopper definition List Manipulation Part 3a,b,c,d.gh (Grasshopper 0.9.76)

number_slider = Slider(0, range=0..100)
construct_point = ConstructPoint(XCoordinate=number_slider, YCoordinate=number_slider, ZCoordinate=number_slider)
series = Series(Start=0, Step=Slider(1, range=0..1), Count=Slider(10, range=0..10))
unit_x = UnitX(Factor=series)
move = Move(Geometry=construct_point, Motion=unit_x)  # -> Geometry, Transform
unit_y = UnitY(Factor=Slider(5, range=0..10))
panel = Panel(move.Geometry)
move_2 = Move(Geometry=move.Geometry, Motion=unit_y)  # -> Geometry, Transform
panel_2 = Panel(move_2.Geometry)
list_item = ListItem(List=move_2.Geometry, Index=Slider(1, range=0..10), Wrap=True)
line = Line(StartPoint=move.Geometry, EndPoint=move_2.Geometry)
panel_3 = Panel(line)
line_2 = Line(StartPoint=list_item, EndPoint=move.Geometry)
