# Grasshopper definition Mesh Smoothing.gh (Grasshopper 1.0.7)
# plug-ins: MeshEdit Components, Weaverbird

number_slider = Slider(2, range=0..10)
brep = Brep(<brep referenced from the Rhino model>)
deconstruct_brep = DeconstructBrep(Brep=brep)  # -> Faces, Edges, Vertices
mesh_surface = MeshSurface(Surface=deconstruct_brep.Faces, UCount=number_slider, VCount=number_slider, Overhang=True, Equalize=False)
weaverbird_s_join_meshes_and_weld = WeaverbirdsJoinMeshesAndWeld(Mesh=mesh_surface, Weld=True)
mesh_unifynormals = MeshUnifyNormals(Mesh=weaverbird_s_join_meshes_and_weld)
weaverbird_s_laplacian_smoothing = WeaverbirdsLaplacianSmoothing(MeshCurves=mesh_unifynormals, Level=Slider(64, range=0..100), SmoothNakedEdges=0, Thin=1)
weaverbird_s_catmull_clark_subdivision = WeaverbirdsCatmullClarkSubdivision(MeshCurves=mesh_unifynormals, Level=Slider(2, range=0..10), SmoothNakedEdges=1)
weaverbird_s_catmull_clark_subdivision_2 = WeaverbirdsCatmullClarkSubdivision(MeshCurves=weaverbird_s_laplacian_smoothing, Level=Slider(2, range=0..10), SmoothNakedEdges=1)
unit_y = UnitY(Factor=Slider(7, range=0..100))
move = Move(Geometry=weaverbird_s_catmull_clark_subdivision, Motion=unit_y)  # -> Geometry, Transform
move_2 = Move(Geometry=weaverbird_s_catmull_clark_subdivision_2, Motion=unit_y)  # -> Geometry, Transform
custom_preview = CustomPreview(
    Geometry=move.Geometry,
    Material={diffuse=RGB(221, 160, 221), emission=RGB(66, 48, 66), shine=0.5, specular=RGB(255, 255, 255), transparency=0})
mesh_edges = MeshEdges(Mesh=move.Geometry)  # -> NakedEdges, InteriorEdges, NonManifoldEdges
