# Grasshopper definition Parametric Brick Wall.gh (Grasshopper 0.9.76)

number_slider = Slider(23, range=0..100)
series = Series(Start=0, Step=1, Count=number_slider)
_1 = Integer(1)
subtraction = Subtraction(A=number_slider, B=_1)
range = Range(Domain=Domain(0, 1), Steps=subtraction)
series_2 = Series(Start=0, Step=1, Count=number_slider)
graph_mapper = GraphMapper(range, x0=0, x1=1, y0=0, y1=1, container_name="Sine", Equation_px=[0, 0.2559420764], Equation_py=[0, 1])
construct_point = ConstructPoint(XCoordinate=series_2, YCoordinate=0, ZCoordinate=0)
unit_z = UnitZ(Factor=Slider(20, range=0..100))
multiplication = Multiplication(A=graph_mapper, B=Slider(3, range=0..10))
move = Move(Geometry=construct_point, Motion=unit_z)  # -> Geometry, Transform
construct_point_2 = ConstructPoint(XCoordinate=series, YCoordinate=multiplication, ZCoordinate=0)
interpolate = Interpolate(Vertices=construct_point_2, Degree=3, Periodic=False, KnotStyle=1)  # -> Curve, Length, Domain
polyline = PolyLine(Vertices=move.Geometry, Closed=False)
loft = Loft(
    Curves=[interpolate.Curve, polyline],
    Options={Adjust=False, Closed=False, LoftEnds=0, LoftSimp=0, LoftType=0, Rebuild=10, Refit=0.01})
number_slider_2 = Slider(1, range=0..1)
unit_z_2 = UnitZ(Factor=1)
division = Division(A=number_slider_2, B=Slider(2, range=0..10))
contour = Contour(Shape=loft, Point=Point(0, 0, 0), Direction=unit_z_2, Distance=number_slider_2)
horizontal_frames = HorizontalFrames(Curve=contour, Count=Slider(24, range=0..100))  # -> Frames, Parameters
center_box = CenterBox(Base=horizontal_frames.Frames, X=Slider(0.766, range=0..1), Y=Slider(0.642, range=0..10), Z=division)  # -> flatten(Box)
panel = Panel("""1
0""")
panel_2 = Panel(center_box)
cull_pattern = CullPattern(List=center_box, CullPattern=panel)
