# Grasshopper definition Pipe Variable Application v2.gh (Grasshopper 0.9.76)

curve = Curve([<curve referenced from the Rhino model> x7])
brep = Brep(<brep referenced from the Rhino model>)
surface = Surface(<surface referenced from the Rhino model>)
curve_2 = Curve([<curve referenced from the Rhino model> x11])
project = Project(Curve=curve, Brep=brep, Direction=Vector(0, 0, 1))
project_2 = Project(Curve=curve_2, Brep=surface, Direction=Vector(0, 0, 1))
evaluate_length = EvaluateLength(Curve=project_2, Length=[Slider(0, range=0..100), Slider(0.5, range=0..1), Slider(1, range=0..1)], Normalized=True)  # -> Point, Tangent, Parameter
pipe = Pipe(Curve=project, Radius=Slider(0.25, range=0..1), Caps=0)
panel = Panel("""0.125
0.03125
0.125""")
pipe_variable = PipeVariable(Curve=project_2, Parameters=evaluate_length.Parameter, Radii=panel, Caps=Slider(1, range=0..2))
