# Grasshopper definition Second Skin v2.gh (Grasshopper 0.9.76)

polygon = Polygon(Plane=PlaneXY(0, 0, 0), Radius=Slider(6, range=0..10), Segments=Slider(3, range=0..10), FilletRadius=0)  # -> Polygon, Length
radians = Radians(Degrees=Slider(90, range=0..100))
rotate = Rotate(Geometry=polygon.Polygon, Angle=radians, Plane=PlaneXY(0, 0, 0))  # -> Geometry, Transform
number_slider = Slider(1, range=0..1)
number_slider_2 = Slider(2, range=0..10)
explode = Explode(Curve=rotate.Geometry, Recursive=True)  # -> Segments, Vertices
list_item = ListItem(List=explode.Segments, Index=number_slider, Wrap=True)
list_item_2 = ListItem(List=explode.Segments, Index=0, Wrap=True)
list_item_3 = ListItem(List=explode.Segments, Index=number_slider_2, Wrap=True)
list_item_4 = ListItem(List=explode.Vertices, Index=0, Wrap=True)
list_item_5 = ListItem(List=explode.Vertices, Index=number_slider, Wrap=True)
list_item_6 = ListItem(List=explode.Vertices, Index=number_slider_2, Wrap=True)
mirror_curve = MirrorCurve(Geometry=explode.Segments, Curve=list_item, Tangent=True)
explode_2 = Explode(Curve=mirror_curve, Recursive=True)  # -> Segments, flatten(Vertices)
list_item_7 = ListItem(List=explode_2.Vertices, Index=0, Wrap=True)
list_item_8 = ListItem(List=explode_2.Vertices, Index=number_slider, Wrap=True)
list_item_9 = ListItem(List=explode_2.Vertices, Index=number_slider_2, Wrap=True)
panel = Panel(explode_2.Vertices)
panel_2 = Panel("""0
1
2
3""")
weave = Weave(Pattern=panel_2, Stream0=list_item_4, Stream1=list_item_6, Stream2=list_item_7, Stream3=list_item_8, NullGaps=False)
polyline = PolyLine(Vertices=weave, Closed=Toggle(True))
area = Area(Geometry=polyline)  # -> Area, Centroid

# ----
# Short Length Distance to Midpoint
distance = Distance(PointA=list_item_6, PointB=area.Centroid)

# ----
# Long Length Distance to Midpoint
distance_2 = Distance(PointA=list_item_7, PointB=area.Centroid)

number_slider_3 = Slider(2, range=0..10)
multiplication = Multiplication(A=distance_2, B=number_slider_3)
multiplication_2 = Multiplication(A=distance, B=number_slider_3)
number_slider_4 = Slider(10, range=0..100)
series = Series(Start=0, Step=multiplication_2, Count=number_slider_4)
series_2 = Series(Start=0, Step=multiplication, Count=number_slider_4)
unit_x = UnitX(Factor=series)
unit_x_2 = UnitX(Factor=distance)
move = Move(Geometry=polyline, Motion=unit_x)  # -> Geometry, Transform
unit_y = UnitY(Factor=series_2)
move_2 = Move(Geometry=move.Geometry, Motion=unit_x_2)  # -> Geometry, Transform
unit_y_2 = UnitY(Factor=distance_2)
move_3 = Move(Geometry=move_2.Geometry, Motion=unit_y_2)  # -> Geometry, Transform
subtraction = Subtraction(A=number_slider_4, B=Slider(1, range=0..1))
cull_index = CullIndex(List=move_3.Geometry, Indices=subtraction, Wrap=True)
panel_3 = Panel(move_3.Geometry)
move_4 = Move(Geometry=graft([move.Geometry, cull_index]), Motion=unit_y)  # -> Geometry, Transform
area_2 = Area(Geometry=move_4.Geometry)  # -> Area, Centroid
point = Point(<point referenced from the Rhino model>)
closest_point = ClosestPoint(Point=flatten(area_2.Centroid), Cloud=point)  # -> ClosestPoint, CPIndex, Distance
panel_4 = Panel(move_4.Geometry)
construct_domain = ConstructDomain(DomainStart=Slider(0.202, range=0..1), DomainEnd=Slider(0.764, range=0..1))
bounds = Bounds(Numbers=closest_point.Distance)
panel_5 = Panel(area_2.Centroid)
remap_numbers = RemapNumbers(Value=closest_point.Distance, Source=bounds, Target=construct_domain)  # -> Mapped, Clipped
scale = Scale(Geometry=flatten(move_4.Geometry), Center=flatten(area_2.Centroid), Factor=remap_numbers.Clipped)  # -> Geometry, Transform
panel_6 = Panel(scale.Geometry)
negative = Negative(Value=Slider(2, range=0..2))
number_slider_5 = Slider(2, range=0..10)
number_slider_6 = Slider(3, range=0..10)
number_slider_7 = Slider(1, range=0..1)
unit_z = UnitZ(Factor=negative)
explode_3 = Explode(Curve=flatten(move_4.Geometry), Recursive=True)  # -> Segments, Vertices
move_5 = Move(Geometry=scale.Geometry, Motion=unit_z)  # -> Geometry, Transform
list_item_10 = ListItem(List=explode_3.Vertices, Index=0, Wrap=True)
list_item_11 = ListItem(List=explode_3.Vertices, Index=number_slider_5, Wrap=True)
list_item_12 = ListItem(List=explode_3.Vertices, Index=number_slider_6, Wrap=True)
list_item_13 = ListItem(List=explode_3.Vertices, Index=number_slider_7, Wrap=True)
explode_4 = Explode(Curve=move_5.Geometry, Recursive=True)  # -> Segments, Vertices
unit_z_2 = UnitZ(Factor=Slider(0.683, range=0..1))
list_item_14 = ListItem(List=explode_4.Vertices, Index=0, Wrap=True)
list_item_15 = ListItem(List=explode_4.Vertices, Index=number_slider_7, Wrap=True)
list_item_16 = ListItem(List=explode_4.Vertices, Index=number_slider_5, Wrap=True)
list_item_17 = ListItem(List=explode_4.Vertices, Index=number_slider_6, Wrap=True)
negative_2 = Negative(Value=unit_z_2)
extrude = Extrude(Base=move_5.Geometry, Direction=negative_2)
_4point_surface = _4PointSurface(CornerA=list_item_10, CornerB=list_item_14, CornerC=list_item_15, CornerD=list_item_13)
_4point_surface_2 = _4PointSurface(CornerA=list_item_15, CornerB=list_item_16, CornerC=list_item_11, CornerD=list_item_13)
_4point_surface_3 = _4PointSurface(CornerA=list_item_16, CornerB=list_item_17, CornerC=list_item_12, CornerD=list_item_11)
_4point_surface_4 = _4PointSurface(CornerA=list_item_17, CornerB=list_item_12, CornerC=list_item_10, CornerD=list_item_14)
cap_holes = CapHoles(Brep=extrude)
brep_join = BrepJoin(Breps=[_4point_surface, _4point_surface_2, _4point_surface_3, _4point_surface_4])  # -> Breps, Closed
deconstruct_brep = DeconstructBrep(Brep=cap_holes)  # -> Faces, Edges, Vertices
panel_7 = Panel(explode_3.Vertices)
panel_8 = Panel(deconstruct_brep.Faces)
panel_9 = Panel(list_item_14)
list_item_18 = ListItem(List=deconstruct_brep.Faces, Index=Slider(1, range=0..5), Wrap=True)
