# Grasshopper definition Serpentine Pavillion v3.gh (Grasshopper 1.0.7)

curve = Curve(<curve referenced from the Rhino model>)
unit_z = UnitZ(Factor=Slider(50, range=0..100))
extrude = Extrude(Base=curve, Direction=unit_z)
number_slider = Slider(24, range=0..100)
divide_surface = DivideSurface(Surface=extrude, UCount=number_slider, VCount=number_slider)  # -> Points, flatten(Normals), Parameters

flatten_tree = FlattenTree(Tree=divide_surface.Points, Path="{0}")
list_item = ListItem(List=flatten_tree, Index=0, Wrap=True)  # -> Item, Item1
distance = Distance(PointA=list_item.Item, PointB=list_item.Item1)
division = Division(A=distance, B="2")
negative = Negative(Value=division)
panel = Panel(distance)
construct_domain = ConstructDomain(DomainStart=negative, DomainEnd=division)

flip_matrix = FlipMatrix(Data=divide_surface.Points)  # -> flatten(Data)
list_item_2 = ListItem(List=flip_matrix, Index=0, Wrap=True)  # -> Item, Item1
distance_2 = Distance(PointA=list_item_2.Item, PointB=list_item_2.Item1)
panel_2 = Panel(distance_2)
division_2 = Division(A=distance_2, B="2")
negative_2 = Negative(Value=division_2)
construct_domain_2 = ConstructDomain(DomainStart=negative_2, DomainEnd=division_2)

plane_normal = PlaneNormal(Origin=flatten(divide_surface.Points), ZAxis=flatten(divide_surface.Normals))
rectangle = Rectangle(Plane=plane_normal, XSize=construct_domain, YSize=construct_domain_2, Radius=0)  # -> Rectangle, Length
panel_3 = Panel("""0
1""")
point = Point(<point referenced from the Rhino model>)
reverse_list = ReverseList(List=panel_3)
cull_pattern = CullPattern(List=divide_surface.Normals, CullPattern=panel_3)
cull_pattern_2 = CullPattern(List=rectangle.Rectangle, CullPattern=panel_3)
cull_pattern_3 = CullPattern(List=rectangle.Rectangle, CullPattern=reverse_list)
cull_pattern_4 = CullPattern(List=divide_surface.Normals, CullPattern=panel_3)
area = Area(Geometry=cull_pattern_2)  # -> Area, Centroid
closest_point = ClosestPoint(Point=area.Centroid, Cloud=point)  # -> ClosestPoint, CPIndex, Distance
graph_mapper = GraphMapper(
    closest_point.Distance,
    x0=0,
    x1=30,
    y0=0,
    y1=30,
    container_name="Gaussian",
    factor=0.2,
    mean=0.7709872723,
    sdev=0.2962345481)
point_2 = Point(<point referenced from the Rhino model>)
area_2 = Area(Geometry=cull_pattern_3)  # -> Area, Centroid
point_3 = Point(<point referenced from the Rhino model>)
bounds = Bounds(Numbers=graph_mapper)
number_slider_2 = Slider(3, range=0..10)
construct_domain_3 = ConstructDomain(DomainStart=number_slider_2, DomainEnd=Slider(20, range=0..100))
closest_point_2 = ClosestPoint(Point=area_2.Centroid, Cloud=[point_3, point_2])  # -> ClosestPoint, CPIndex, Distance
reverse = Reverse(Vector=cull_pattern)
graph_mapper_2 = GraphMapper(closest_point_2.Distance, x0=0, x1=25, y0=0, y1=25, container_name="Gaussian", factor=0.2, mean=1, sdev=0.2962345481)
remap_numbers = RemapNumbers(Value=graph_mapper, Source=bounds, Target=construct_domain_3)  # -> Mapped, Clipped
construct_domain_4 = ConstructDomain(DomainStart=number_slider_2, DomainEnd=Slider(10, range=0..100))
bounds_2 = Bounds(Numbers=graph_mapper_2)
amplitude = Amplitude(Vector=flatten(reverse), Amplitude=remap_numbers.Mapped)
remap_numbers_2 = RemapNumbers(Value=graph_mapper_2, Source=bounds_2, Target=construct_domain_4)  # -> Mapped, Clipped
amplitude_2 = Amplitude(Vector=cull_pattern_4, Amplitude=remap_numbers_2.Mapped)
negative_3 = Negative(Value=number_slider_2)
extrude_2 = Extrude(Base=cull_pattern_3, Direction=amplitude_2)
extrude_3 = Extrude(Base=cull_pattern_2, Direction=amplitude)
amplitude_3 = Amplitude(Vector=cull_pattern_4, Amplitude=negative_3)
number_slider_3 = Slider(0, range=0..10)
closest_point_3 = ClosestPoint(Point=area_2.Centroid, Cloud=[point_2, point_3])  # -> ClosestPoint, CPIndex, Distance
move = Move(Geometry=extrude_2, Motion=amplitude_3)  # -> Geometry, Transform
closest_point_4 = ClosestPoint(Point=area.Centroid, Cloud=point)  # -> ClosestPoint, CPIndex, Distance
graph_mapper_3 = GraphMapper(
    closest_point_3.Distance,
    x0=0,
    x1=30,
    y0=0,
    y1=30,
    container_name="Gaussian",
    factor=0.2,
    mean=0.7709872723,
    sdev=0.2962345481)
graph_mapper_4 = GraphMapper(closest_point_4.Distance, x0=0, x1=25, y0=0, y1=25, container_name="Gaussian", factor=0.2, mean=1, sdev=0.4844174385)
construct_domain_5 = ConstructDomain(DomainStart=number_slider_3, DomainEnd=Slider(15, range=0..100))
bounds_3 = Bounds(Numbers=graph_mapper_3)
construct_domain_6 = ConstructDomain(DomainStart=number_slider_3, DomainEnd=Slider(16, range=0..100))
remap_numbers_3 = RemapNumbers(Value=graph_mapper_3, Source=bounds_3, Target=construct_domain_5)  # -> Mapped, Clipped
bounds_4 = Bounds(Numbers=graph_mapper_4)
reverse_2 = Reverse(Vector=cull_pattern)
amplitude_4 = Amplitude(Vector=cull_pattern_4, Amplitude=remap_numbers_3.Mapped)
remap_numbers_4 = RemapNumbers(Value=graph_mapper_4, Source=bounds_4, Target=construct_domain_6)  # -> Mapped, Clipped
amplitude_5 = Amplitude(Vector=flatten(reverse_2), Amplitude=remap_numbers_4.Mapped)
move_2 = Move(Geometry=move.Geometry, Motion=amplitude_4)  # -> Geometry, Transform
move_3 = Move(Geometry=extrude_3, Motion=amplitude_5)  # -> Geometry, Transform
custom_preview = CustomPreview(
    Geometry=[move_3.Geometry, move_2.Geometry],
    Material={diffuse=RGB(221, 160, 221), emission=RGB(66, 48, 66), shine=0.5, specular=RGB(255, 255, 255), transparency=0})
