# Grasshopper definition Simplifying Curve.gh (Grasshopper 1.0.7)

curve = Curve([<curve referenced from the Rhino model> x1669])
explode = Explode(Curve=curve, Recursive=True)  # -> Segments, Vertices
length = Length(Curve=explode.Segments)
smaller_than = SmallerThan(FirstNumber=length, SecondNumber=Slider(0.39, range=0..1))  # -> SmallerThan, OrEqualTo
panel = Panel(length)
gate_not = GateNot(A=smaller_than.SmallerThan)
cull_pattern = CullPattern(List=explode.Segments, CullPattern=smaller_than.SmallerThan)
cull_pattern_2 = CullPattern(List=explode.Segments, CullPattern=gate_not)
panel_2 = Panel(gate_not)
join_curves = JoinCurves(Curves=flatten(cull_pattern), Preserve=False)
panel_3 = Panel(join_curves)
explode_2 = Explode(Curve=join_curves, Recursive=True)  # -> Segments, Vertices
polyline = PolyLine(Vertices=explode_2.Vertices, Closed=False)
panel_4 = Panel(explode_2.Vertices)
reduce = Reduce(Polyline=polyline, Tolerance=Slider(0.002, range=0..0.5))  # -> Polyline, Reduction
average = Average(Input=flatten(reduce.Reduction))
explode_3 = Explode(Curve=reduce.Polyline, Recursive=True)  # -> Segments, Vertices
radians = Radians(Degrees=Slider(30, range=0..1000))
interpolate = Interpolate(Vertices=explode_3.Vertices, Degree=3, Periodic=False, KnotStyle=1)  # -> Curve, Length, Domain
panel_5 = Panel(interpolate.Curve)
kinky_curve = KinkyCurve(Vertices=explode_3.Vertices, Degree=3, Angle=radians)  # -> Curve, Length, Domain
panel_6 = Panel(average)
merge = Merge(Data1=kinky_curve.Curve, Data2=cull_pattern_2)  # -> flatten(Result)
simplify_curve = SimplifyCurve(Curve=merge, Tolerance=Slider(0.017, range=0..1))  # -> Curve, Simplified
join_curves_2 = JoinCurves(Curves=simplify_curve.Curve, Preserve=False)
panel_7 = Panel(join_curves_2)
