# Grasshopper definition Surface Manipulation with Curve.gh (Grasshopper 1.0.5)

number_slider = Slider(30, range=0..100)

curve = Curve(<curve referenced from the Rhino model>)
divide_curve = DivideCurve(Curve=curve, Count=Slider(82, range=0..100), Kinks=False)  # -> Points, Tangents, Parameters

plane_surface = PlaneSurface(Plane=PlaneXY(0, 0, 0), XSize=number_slider, YSize=number_slider)
number_slider_2 = Slider(21, range=0..100)
divide_surface = DivideSurface(Surface=plane_surface, UCount=number_slider_2, VCount=number_slider_2)  # -> flatten(Points), Normals, Parameters
closest_point = ClosestPoint(Point=divide_surface.Points, Cloud=divide_curve.Points)  # -> ClosestPoint, CPIndex, Distance
graph_mapper = GraphMapper(
    closest_point.Distance,
    x0=0,
    x1=3,
    y0=0,
    y1=3,
    container_name="Gaussian",
    factor=0.2,
    mean=0.07121220231,
    sdev=0.251565963)
construct_domain = ConstructDomain(DomainStart=Slider(0, range=0..100), DomainEnd=Slider(1.687, range=0..20))
bounds = Bounds(Numbers=graph_mapper)
# When you use a surface from points, you must flatten!!! You flatten because it will now read it as one list instead of using one series of points
remap_numbers = RemapNumbers(Value=graph_mapper, Source=bounds, Target=construct_domain)  # -> Mapped, Clipped
amplitude = Amplitude(Vector=flatten(divide_surface.Normals), Amplitude=remap_numbers.Mapped)
move = Move(Geometry=divide_surface.Points, Motion=amplitude)  # -> Geometry, Transform
addition = Addition(A=number_slider_2, B=Slider(1, range=0..1))
panel = Panel(move.Geometry)
flatten_tree = FlattenTree(Tree=move.Geometry, Path="{0}")
surface_from_points = SurfaceFromPoints(Points=flatten_tree, UCount=addition, Interpolate=False)
unit_z = UnitZ(Factor=Slider(0.599, range=0..10))
extrude = Extrude(Base=surface_from_points, Direction=unit_z)
unit_x = UnitX(Factor=1)
contour = Contour(Shape=extrude, Point=Point(0, 0, 0), Direction=unit_x, Distance=Slider(0.75, range=0..10))
unit_x_2 = UnitX(Factor=Slider(0.373, range=0..1))
extrude_2 = Extrude(Base=contour, Direction=unit_x_2)
cap_holes = CapHoles(Brep=extrude_2)
