# Grasshopper definition Surface Morph Depth.gh (Grasshopper 1.0.5)

surface = Surface(<surface referenced from the Rhino model>)
dimensions = Dimensions(Surface=surface)  # -> UDimension, VDimension
plane_surface = PlaneSurface(Plane=PlaneXY(0, 0, 0), XSize=dimensions.UDimension, YSize=dimensions.VDimension)
populate_2d = Populate2D(Region=plane_surface, Count=100, Seed=1)
voronoi = Voronoi(Points=populate_2d, Boundary=plane_surface, BruteForceOverride=False)
ghpython_script = GhPythonScript(crv=voronoi, dir=populate_2d, dis=Slider(0.25, range=0..1))  # -> out, a
# ---------- ghpython_script: Python ----------
__author__ = "leodeigo"
__version__ = "2018.02.02"

import rhinoscriptsyntax as rs

a=rs.OffsetCurve(crv,dir,dis)
# ---------- end ghpython_script ----------
region_difference = RegionDifference(CurvesA=voronoi, CurvesB=flatten(ghpython_script.a))
unit_z = UnitZ(Factor=Slider(4, range=0..10))
boundary_surfaces = BoundarySurfaces(Edges=region_difference)
extrude = Extrude(Base=boundary_surfaces, Direction=unit_z)
bounding_box = BoundingBox(Content=flatten(extrude), Plane=PlaneXY(0, 0, 0), UnionBox=True)  # -> Box, Box_2
negative = Negative(Value=Slider(1, range=0..5))
surface_morph = SurfaceMorph(
    Geometry=extrude,
    Reference=bounding_box.Box,
    Surface=reparameterize(surface),
    UDomain=Slider(0.5, range=0..1),
    VDomain=Slider(0.5, range=0..1),
    WDomain=negative)
