# Grasshopper definition Concatenate Text.gh (Grasshopper 1.0.7)
# plug-ins: Heteroptera

replace_text = ReplaceText(RecursiveReplace=False)
match_text = MatchText(Case=True)
characters = Characters()  # -> Result, Unicode
member_index = MemberIndex()  # -> Index, Count
format = Format(Culture=127)
c_script = CSharpScript()  # -> Out, A
number_slider = Slider(12, range=0..100)
series = Series(Start=0, Step=expr("x+1", number_slider), Count=10)
series_2 = Series(Start=0, Step=expr("x+1", number_slider), Count=10)
rectangle = Rectangle(Plane=PlaneXY(0, 0, 0), XSize=number_slider, YSize=number_slider, Radius=0)  # -> Rectangle, Length
unit_y = UnitY(Factor=series_2)
unit_x = UnitX(Factor=series)
move = Move(Geometry=rectangle.Rectangle, Motion=unit_x)  # -> Geometry, Transform
move_2 = Move(Geometry=graft(move.Geometry), Motion=unit_y)  # -> Geometry, Transform
list_length = ListLength(List=move_2.Geometry)
volume = Volume()  # -> Volume, Centroid
area = Area()  # -> Area, Centroid
series_3 = Series(Start="1", Step=1, Count=list_length)
point = Point(<point referenced from the Rhino model>)
series_4 = Series(Start="1", Step=1, Count=list_length)
polygon_center = PolygonCenter(Polyline=move_2.Geometry)  # -> CenterV, CenterE, CenterA
center = Center()  # -> Center, Dimension
closest_point = ClosestPoint(Point=flatten(polygon_center.CenterV), Cloud=point)  # -> ClosestPoint, CPIndex, Distance
flip_matrix = FlipMatrix(Data=series_4)
bounds = Bounds(Numbers=closest_point.Distance)
construct_domain = ConstructDomain(DomainStart=Slider(4, range=0..10), DomainEnd=Slider(0.8, range=0..1))
remap_numbers = RemapNumbers(Value=closest_point.Distance, Source=bounds, Target=construct_domain)  # -> Mapped, Clipped
panel = Panel(flip_matrix)
concatenate = Concatenate(B=flip_matrix, C="-", Fragment_A="NORTH", Fragment_B="-", A=series_3)
circle = Circle(Plane=flatten(polygon_center.CenterV), Radius=remap_numbers.Mapped)
text_tag_3d = TextTag3D(Location=polygon_center.CenterV, Text=concatenate, Size=1, Justification=5)
panel_2 = Panel(concatenate)
