# Grasshopper definition Part 2b.gh (Grasshopper 0.9.76)

xy_plane = XYPlane(Origin=Point(0, 0, 0))
number_slider = Slider(15, range=0..15)
polygon = Polygon(Plane=xy_plane, Radius=Slider(4, range=0..10), Segments=Slider(4, range=0..10), FilletRadius=0)  # -> Polygon, Length
radians = Radians(Degrees=Slider(45, range=0..100))
series = Series(Start=0, Step=Slider(1, range=0..10), Count=number_slider)
construct_domain = ConstructDomain(DomainStart=Slider(0, range=0..100), DomainEnd=Slider(180, range=0..180))
rotate = Rotate(Geometry=polygon.Polygon, Angle=radians, Plane=xy_plane)  # -> Geometry, Transform
unit_z = UnitZ(Factor=series)
subtraction = Subtraction(A=number_slider, B=Slider(1, range=0..1))
range = Range(Domain=construct_domain, Steps=subtraction)
move = Move(Geometry=rotate.Geometry, Motion=unit_z)  # -> Geometry, Transform
radians_2 = Radians(Degrees=range)
rotate_2 = Rotate(Geometry=move.Geometry, Angle=radians_2, Plane=xy_plane)  # -> Geometry, Transform
negative = Negative(Value=Slider(0.125, range=0..1))
offset = Offset(Curve=rotate_2.Geometry, Distance=negative, Plane=PlaneXY(0, 0, 0), Corners=1)
region_difference = RegionDifference(CurvesA=rotate_2.Geometry, CurvesB=offset)
boundary_surfaces = BoundarySurfaces(Edges=region_difference)
unit_z_2 = UnitZ(Factor=Slider(0.25, range=0..1))
extrude = Extrude(Base=boundary_surfaces, Direction=unit_z_2)
