# Grasshopper definition Waffle Script.gh (Grasshopper 0.9.76)

number_slider = Slider(25, range=0..100)
number_slider_2 = Slider(31, range=0..100)
plane_surface = PlaneSurface(Plane=PlaneXY(0, 0, 0), XSize=number_slider, YSize=number_slider)
divide_surface = DivideSurface(Surface=plane_surface, UCount=number_slider_2, VCount=number_slider_2)  # -> Points, Normals, Parameters
point = Point(<point referenced from the Rhino model>)
point_2 = Point(<point referenced from the Rhino model>)
point_3 = Point(<point referenced from the Rhino model>)
point_4 = Point(<point referenced from the Rhino model>)
construct_domain = ConstructDomain(DomainStart=Slider(0, range=0..100), DomainEnd=Slider(6, range=0..10))
merge = Merge(Data1=point, Data2=point_2, Data3=point_3, Data4=point_4)  # -> flatten(Result)
closest_point = ClosestPoint(Point=divide_surface.Points, Cloud=merge)  # -> ClosestPoint, CPIndex, Distance
graph_mapper = GraphMapper(closest_point.Distance, x0=0, x1=20, y0=0, y1=20, container_name="Bezier", cpx=[0, 0, 1, 1], cpy=[0, 1, 1, 1])
bounds = Bounds(Numbers=graph_mapper)
remap_numbers = RemapNumbers(Value=graph_mapper, Source=bounds, Target=construct_domain)  # -> Mapped, Clipped
amplitude = Amplitude(Vector=divide_surface.Normals, Amplitude=remap_numbers.Mapped)
move = Move(Geometry=divide_surface.Points, Motion=amplitude)  # -> flatten(Geometry), Transform
addition = Addition(A=number_slider_2, B=Slider(1, range=0..1))
surface_from_points = SurfaceFromPoints(Points=move.Geometry, UCount=addition, Interpolate=False)
unit_z = UnitZ(Factor=Slider(1, range=0..1))
extrude = Extrude(Base=surface_from_points, Direction=unit_z)
number_slider_3 = Slider(1, range=0..1)
unit_y = UnitY(Factor=1)
unit_x = UnitX(Factor=1)
# Thickness of Contour: 1/8"
contour = Contour(Shape=extrude, Point=Point(0, 0, 0), Direction=unit_x, Distance=number_slider_3)
contour_2 = Contour(Shape=extrude, Point=Point(0, 0, 0), Direction=unit_y, Distance=number_slider_3)
division = Division(A=Slider(0.125, range=0..1), B=Slider(2, range=0..10))
unit_x_2 = UnitX(Factor=division)
unit_y_2 = UnitY(Factor=division)
negative = Negative(Value=unit_x_2)
negative_2 = Negative(Value=unit_y_2)
extrude_2 = Extrude(Base=contour, Direction=unit_x_2)
extrude_3 = Extrude(Base=contour, Direction=negative)
extrude_4 = Extrude(Base=contour_2, Direction=unit_y_2)
extrude_5 = Extrude(Base=contour_2, Direction=negative_2)
cap_holes = CapHoles(Brep=extrude_2)
cap_holes_2 = CapHoles(Brep=extrude_3)
cap_holes_3 = CapHoles(Brep=extrude_4)
cap_holes_4 = CapHoles(Brep=extrude_5)
solid_union = SolidUnion(Breps=[cap_holes, cap_holes_2])
unit_z_2 = UnitZ(Factor=Slider(0.25, range=0..1))
solid_union_2 = SolidUnion(Breps=[cap_holes_3, cap_holes_4])
move_2 = Move(Geometry=solid_union, Motion=unit_z_2)  # -> Geometry, Transform
panel = Panel(move_2.Geometry)
flatten_tree = FlattenTree(Tree=move_2.Geometry, Path="{0}")
flatten_tree_2 = FlattenTree(Tree=solid_union_2, Path="{0}")
solid_difference = SolidDifference(BrepsA=flatten_tree, BrepsB=flatten_tree_2)
